# Grasshopper definition fetchFromDB.gh (Grasshopper 1.0.7)
# plug-ins: LunchBox, EleFront, Human, Bifocals

# ----
# CreatePanels
number_slider = Slider(5000, range=0..10000)
xz = XZPlane(Origin=Point(0, 0, 0))
number_slider_2 = Slider(1, range=0..10)
rectangle = Rectangle(Plane=xz, XSize=number_slider, YSize=number_slider, Radius=0)  # -> Rectangle, Length
tric = TrianglePanelsC(Surface=rectangle.Rectangle, UDivisions=number_slider_2, VDivisions=number_slider_2)
crv = Curve(tric)
neg = Negative(Value=Slider(40, range=0..100))
offset = OffsetCurve(Curve=crv, Distance=neg, Corners=1)
srf = Surface(flatten(offset))

# ----
# Generate Date
number_slider_3 = Slider(1, range=0..10)
series = Series(Start=number_slider_3, Step=number_slider_3, Count=Slider(4, range=0..10))
merge = Merge(Data1=Slider(2022, range=0..10000), Data2=Slider(11, range=0..100))
join = TextJoin(Text=merge, Join="-")
concat = Concatenate(FragmentA=join, FragmentB="-", FragmentC=series)
panel = Panel(concat)

# ----
# PanelFrame
number_slider_4 = Slider(100, range=0..100)
boundary = BoundarySurfaces(Edges=flatten([crv, offset]))
Y = UnitY(Factor=number_slider_4)
extr = Extrude(Base=boundary, Direction=Y)
division = Division(A=Y, B=Slider(2, range=0..10))
rev = Reverse(Vector=division)
move = Move(Geometry=extr, Motion=rev)  # -> Geometry, Transform
preview = CustomPreview(Geometry=move.Geometry, Material=ColourSwatch(SwatchColor=RGB(201, 187, 187)))

# ----
# initialAttributes
index = ItemIndex(List=srf, Item=srf)
concat_2 = Concatenate(FragmentA="P-", FragmentB=index)
merge_2 = Merge(Data1=simplify(graft(concat_2)), Data2=simplify(graft(panel)))
panel_2 = Panel(merge_2)

# ----
# sorPanelsById
panel_3 = Panel("P-")

# ----
# DeleteGeometry
number_slider_5 = Slider(1, range=0..3)

# ----
# attributesUpdate
number_slider_6 = Slider(1, range=0..10)
deliverydate = Text(panel)
list = ItemSelector(deliverydate, {"2022-11-1", "2022-11-2", "2022-11-3", "2022-11-4"}, selected="2022-11-3")
int = Integer("1")

# ----
# METHOD
panel_4 = Panel("panel")
list_2 = ValueList({"POST": 0, "UPDATE": 1, "DELETE": 2}, selected="DELETE")
layer = DefineLayer(Name=panel_4)

# ----
# getCurrentData
layer_2 = Text(panel_4)
reflay = ReferenceByLayer(LayerName=layer_2)
getua = GetUserAttributes(Geometry=reflay)  # -> Keys, Values, BakeName

item = ListItem(List=getua.Values, Index=0, Wrap=True)  # -> flatten(Item)
split = TextSplit(Text=item, Separators=panel_3)
item_2 = ListItem(List=reverse(split), Index=0, Wrap=True)  # -> flatten(Item)
panel_5 = Panel(item_2)
sort = SortList(Keys=panel_5, ValuesA=panel_5)  # -> Keys, ValuesA
mindex = MemberIndex(Set=sort.ValuesA, Member=panel_5)  # -> flatten(Index), Count
panel_6 = Panel(mindex.Index)
item_3 = ListItem(List=reflay, Index=panel_6, Wrap=True)
getua_2 = GetUserAttributes(Geometry=item_3)  # -> Keys, Values, BakeName
panel_7 = Panel(getua_2.Values)

python = GhPythonScript(excute=Toggle(True), id=getua_2.Values)  # -> response, attributes
# ---------- python: Python ----------
import urllib2
import json
 
def getAllPanels():
 
  url = 'http://localhost:3000/api/panels/' + id
 
  response = json.load(urllib2.urlopen(url))
  print response
   
  _id = response['_id']
  delivery = response['delivery']
   
  return _id,delivery
 
if excute:
    attributes = getAllPanels();
# ---------- end python ----------

txt = Text(python.attributes)
tstat = TreeStatistics(Tree=txt)  # -> Paths, Length, Count
cull_i = CullIndex(List=item_3, Indices=number_slider_5, Wrap=True)
item_4 = ListItem(List=tstat.Paths, Index=number_slider_5, Wrap=True)
split_2 = SplitTree(Data=txt, Masks=flatten(item_4))  # -> Positive, Negative
item_5 = ListItem(List=split_2.Positive, Index=0, Wrap=True)
panel_8 = Panel(split_2.Negative)
panel_9 = Panel(item_5)

panel_10 = Panel(python.attributes)

tstat_2 = TreeStatistics(Tree=python.attributes)  # -> Paths, Length, Count
item_6 = ListItem(List=tstat_2.Paths, Index=number_slider_6, Wrap=True)
split_3 = SplitTree(Data=python.attributes, Masks=flatten(item_6))  # -> Positive, Negative
replace = ReplaceItems(List=split_3.Positive, Item=list, Indices=int, Wrap=False)
merge_3 = Merge(Data1=split_3.Negative, Data2=replace)
unflatten = UnflattenTree(Tree=merge_3, Guide=python.attributes)
panel_11 = Panel(unflatten)

filter = StreamFilter(Gate=list_2, Stream0=merge_2, Stream1=unflatten, Stream2=split_2.Negative)
filter_2 = StreamFilter(Gate=list_2, Stream0=srf, Stream1=item_3, Stream2=cull_i)
item_7 = ListItem(List=filter, Index=0, Wrap=True)
attributes = DefineObjectAttributes(UserKeys="id", UserValues=item_7, Layer=layer)
preview_2 = CustomPreview(Geometry=filter_2, Material=ColourSwatch(SwatchColor=RGB(255, 255, 255)))

# ----
# Visible Attributes
number_slider_7 = Slider(-200, range=-600..-99)
item_8 = ListItem(List=filter, Index=0, Wrap=True)  # -> Item, Item1
area = Area(Geometry=filter_2)  # -> Area, Centroid
Z = UnitZ(Factor=number_slider_7)
move_2 = Move(Geometry=area.Centroid, Motion=Z)  # -> Geometry, Transform
swatch = ColourSwatch(SwatchColor=RGB(0, 0, 0))
tag = TextTag(Location=area.Centroid, Text=flatten(item_8.Item), Colour=swatch)
tag_2 = TextTag(Location=move_2.Geometry, Text=flatten(item_8.Item1), Colour=swatch)

# ----
# Bake
button = Button()
bake = BakeObjects(Geometry=filter_2, Attributes=flatten(attributes), BakeName="panelBake", Bake=button)

# ----
# API
# Post
# PUT
# DELETE
# GET ALL
update_attributes = Data(replace)
deleteattributes = Text(panel_9)
post_attributes = Data(filter)
trigger = Boolean(button)
method = Integer(list_2)
python_2 = GhPythonScript(excute=Button())  # -> response
# ---------- python_2: Python ----------
import urllib2
import json

def getAllPanels():

  url = 'http://localhost:3000/api/panels'

  response = json.load(urllib2.urlopen(url))
  for value in response:
    print value

if excute:
    getAllPanels();
# ---------- end python_2 ----------
python_3 = GhPythonScript(method=method, trigger=trigger, attributes=post_attributes)  # -> response; inputs attributes: list
# ---------- python_3: Python ----------
import urllib2
import json

def postPanel():

  url = 'http://localhost:3000/api/panels/'
  handler = urllib2.HTTPHandler()
  opener = urllib2.build_opener(handler)
  
  id = attributes[0]
  delivery = attributes[1]

  sendValues = {
      "_id":id,
      "delivery":delivery
  }
    
  sendValuesJson = json.dumps(sendValues).encode("utf8")
  
  request = urllib2.Request(url, sendValuesJson)
  request.add_header("Content-Type",'application/json')
  response = json.load(urllib2.urlopen(request))
  print response

if method == 0 and trigger == True:
    postPanel()
# ---------- end python_3 ----------
python_4 = GhPythonScript(method=method, trigger=trigger, attributes=update_attributes)  # -> response; inputs attributes: list
# ---------- python_4: Python ----------
import urllib2
import json

def updatePanel():
  id = attributes[0]
  delivery = attributes[1]

  url = 'http://localhost:3000/api/panels/'+id
  handler = urllib2.HTTPHandler()
  opener = urllib2.build_opener(handler)
  


  sendValues = {
      "_id":id,
      "delivery":delivery
  }
    
  sendValuesJson = json.dumps(sendValues).encode("utf8")
  
  request = urllib2.Request(url, sendValuesJson)
  request.add_header("Content-Type",'application/json')
  request.get_method = lambda: 'PUT'
  response = json.load(urllib2.urlopen(request))
  print response

if method == 1 and trigger == True:
    updatePanel()
# ---------- end python_4 ----------
python_5 = GhPythonScript(method=method, trigger=trigger, attributes=deleteattributes)  # -> response; inputs attributes: list
# ---------- python_5: Python ----------
import urllib2
import json

def deletePanel():
    
  id = attributes[0]
  

  url = 'http://localhost:3000/api/panels/'+id

  handler = urllib2.HTTPHandler()
  opener = urllib2.build_opener(handler)
    
  request = urllib2.Request(url)
  request.add_header("Content-Type",'application/json')
  request.get_method = lambda: 'DELETE'
  response = json.load(urllib2.urlopen(request))
  print response
  

if method == 2 and trigger == True:
    deletePanel()
# ---------- end python_5 ----------
panel_12 = Panel(python_2)
panel_13 = Panel(python_4)
panel_14 = Panel(python_5)
panel_15 = Panel(python_3)
